# Grasshopper definition Geenerative Urban Planning.gh (Grasshopper 1.0.7)
# plug-ins: MeerkatGIS

shapefile = ImportShapefile(OnOff=Toggle(False))
path = FilePath("C:\Users\659\Documents\GitHub\ArcRhino\UseCase\BFN_Parcels.mkgis")
path_2 = FilePath("C:\Users\659\Documents\GitHub\ArcRhino\UseCase\BFN_Buildings.mkgis")
path_3 = FilePath("C:\Users\659\Documents\GitHub\ArcRhino\UseCase\BFN_StreetEdge.mkgis")
parse_mkgis = ParseMeerkatFile(MeerkatFile=path)  # -> DateCropped, UserAndMachineNamed, PathForFiles, ShapeType, ShapeCountInSource, BoundsInPointSpace, BoundsInLatLong, FieldNames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

# ----
# Data Set File Paths Or Source Directory: Data from A22 Project should be present in the Rhino File
rhino_files_associated_with_script = Panel("Bloomfield_mapping_layers_v01")
class_plug_in_library = Panel("\\GoogleDrive\_X_Refrance\Gh_Plugins")

parse_mkgis_2 = ParseMeerkatFile(MeerkatFile=path_2)  # -> DateCropped, UserAndMachineNamed, PathForFiles, ShapeType, ShapeCountInSource, BoundsInPointSpace, BoundsInLatLong, FieldNames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
parse_mkgis_3 = ParseMeerkatFile(MeerkatFile=path_3)  # -> DateCropped, UserAndMachineNamed, PathForFiles, ShapeType, ShapeCountInSource, BoundsInPointSpace, BoundsInLatLong, FieldNames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
geo = Geometry(parse_mkgis.GeometryPerShape)
pline = PolyLine(Vertices=geo, Closed=False)
pt = Point(parse_mkgis_2.GeometryPerShape)
panel = Panel(parse_mkgis_2.FieldNames)
pline_2 = PolyLine(Vertices=parse_mkgis_2.GeometryPerShape, Closed=Toggle(True))
area = Area(Geometry=pline)  # -> Area, Centroid
ins = InsertItems(List=parse_mkgis_2.FieldValuesPerShape, Item=pline_2, Indices=Slider(21, range=0..100), Wrap=True)
filter = GhPythonScript(tree=ins, upper_area=Slider(5000, range=0..20000), lower_area=Slider(1000, range=0..20000))  # -> out, a; inputs tree: tree, upper_area: Int32, lower_area: Int32
# ---------- filter: Python ----------
__author__ = "ek542"
__version__ = "2019.10.19"

import rhinoscriptsyntax as rs
from System import Object
import Grasshopper.Kernel as gh
from Grasshopper import DataTree
from Grasshopper.Kernel.Data import GH_Path

tree_new = DataTree[Object]()
count = 0

for i in range(tree.BranchCount):
    branch = tree.Branch(i)
    area = float(branch[20])
    price = float(branch[7])
    if (area >= lower_area and area <= upper_area and price > 100):
         path = GH_Path(count)
         for item in branch:
            tree_new.Add(item, path)
         count +=  1

a = tree_new
# ---------- end filter ----------
item = ListItem(List=filter.a, Index="21", Wrap=True)
geo_2 = Geometry(item)
pline_3 = PolyLine(Vertices=parse_mkgis_3.GeometryPerShape, Closed=False)
geo_3 = Geometry(parse_mkgis_3.BoundsInPointSpace)
area_2 = Area(Geometry=geo_2)  # -> Area, flatten(Centroid)
join = JoinCurves(Curves=flatten(pline_3), Preserve=False)
explode = Explode(Curve=geo_3, Recursive=True)  # -> Segments, Vertices
pdecon = Deconstruct(Point=explode.Vertices)  # -> XComponent, YComponent, ZComponent
item_2 = ListItem(List=ins, Index=Slider(21, range=0..100), Wrap=True)  # -> flatten(Item)
area_3 = Area(Geometry=item_2)  # -> Area, Centroid

# ---- group: HEIGHTS / Iterate
number_slider = Slider(10, range=0..45)
item_3 = ListItem(List=area_2.Centroid, Index=number_slider, Wrap=True)  # -> flatten(Item)
dist = Distance(PointA=item_3, PointB=area_3.Centroid)

# ----
sort = SortList(Keys=pdecon.YComponent, ValuesA=explode.Vertices)  # -> Keys, reverse(ValuesA)
item_4 = ListItem(List=filter.a, Index="7", Wrap=True)  # -> flatten(Item)

# ---- group: HEIGHTS / Visualize Iteration
item_5 = ListItem(List=flatten(geo_2), Index=number_slider, Wrap=True)
boundary = BoundarySurfaces(Edges=item_5)

# ----
sort_2 = SortList(Keys=pdecon.XComponent, ValuesA=sort.ValuesA)  # -> Keys, ValuesA
item_6 = ListItem(List=sort_2.ValuesA, Index=0, Wrap=True)
item_7 = ListItem(List=item_4, Index=number_slider, Wrap=True)
larger = LargerThan(FirstNumber=dist, SecondNumber=1)  # -> LargerThan, OrEqualTo
dispatch = Dispatch(List=area_3.Centroid, DispatchPattern=larger.LargerThan)  # -> ListA, ListB
dispatch_2 = Dispatch(List=dist, DispatchPattern=larger.LargerThan)  # -> ListA, ListB

# ---- group: HEIGHTS
max_distance = Slider(202, range=0..1000)
item_8 = ListItem(List=parse_mkgis_2.FieldValuesPerShape, Index=Slider(18, range=0..20), Wrap=True)
larger_2 = LargerThan(FirstNumber=dispatch_2.ListA, SecondNumber=max_distance)  # -> LargerThan, OrEqualTo
trunc = Truncate(Input=item_8, TruncationFactor="0.9")  # -> flatten(Result)
heights = Dispatch(List=trunc, DispatchPattern=larger_2.LargerThan)  # -> ListA, ListB
distance = Dispatch(List=dispatch_2.ListA, DispatchPattern=larger_2.LargerThan)  # -> ListA, ListB

# ----
number_slider_2 = Slider(20, range=0..100)
area_4 = Area(Geometry=geo_3)  # -> Area, Centroid
sqgrid = Square(Plane=item_6, Size=Slider(50, range=0..100), ExtentX=number_slider_2, ExtentY=number_slider_2)  # -> flatten(Cells), Points

# ---- group: HEIGHTS / Visualize Bldgs
nearby_bldgs = Dispatch(List=dispatch.ListA, DispatchPattern=larger_2.LargerThan)  # -> ListA, ListB
geo_4 = Geometry(nearby_bldgs.ListB)

# ----
rotate = Rotate(Geometry=sqgrid.Cells, Angle=degrees(Slider(10, range=0..360)), Plane=area_4.Centroid)  # -> Geometry, Transform

# ---- group: HEIGHTS / WEIGHTED AVERAGE
ma = MassAddition(Input=distance.ListB)  # -> Result, PartialResults
division = Division(A=distance.ListB, B=ma.Result)
multiplication = Multiplication(A=heights.ListB, B=division)
ma_2 = MassAddition(Input=multiplication)  # -> Result, PartialResults

# ----
galapagos = Galapagos(fitness=addition, gene=number_slider)
area_5 = Area(Geometry=rotate.Geometry)  # -> Area, Centroid
incurves = PointInCurves(Point=area_5.Centroid, Curves=flatten(join))  # -> Relationship, Index, Point
addition = Addition(A=ma_2.Result, B=item_7)
dispatch_3 = Dispatch(List=area_5.Centroid, DispatchPattern=incurves.Relationship)  # -> ListA, ListB
geo_5 = Geometry(dispatch_3.ListA)
incurves_2 = PointInCurves(Point=geo_5, Curves=flatten(item_2))  # -> Relationship, Index, Point
dispatch_4 = Dispatch(List=geo_5, DispatchPattern=incurves_2.Relationship)  # -> ListA, ListB
geo_6 = Geometry(dispatch_4.ListB)

# ---- group: Generate Isovist
number_slider_3 = Slider(50, range=0..100)
number_slider_4 = Slider(200, range=1..5000)

# ---- group: Generate Isovist / get Centerpoint of vacant lot
point = Point(geo_6)

# ----
xy = XYPlane(Origin=point)
rotate_2 = Rotate(Geometry=xy, Angle=degrees(Slider(10, range=0..10)), Plane=xy)  # -> Geometry, Transform

merge = Merge(Data1=pline_2, Data2=join)  # -> flatten(Result)
panel_2 = Panel(point)

# ---- group: Generate Isovist / Buildings grouped by Vacant Parcel that it is close to
geometry = Geometry(merge)

# ---- group: Generate Isovist
isovist = IsoVist(Plane=rotate_2.Geometry, Count=number_slider_3, Radius=number_slider_4, Obstacles=geometry)  # -> Points, Distance, Index

# ----
panel_3 = Panel(isovist.Points)

# ---- group: Generate Isovist / View Lines
line = Line(StartPoint=graft(point), EndPoint=isovist.Points)

# ---- group: Generate Isovist / Parimiter Line
polyline = PolyLine(Vertices=isovist.Points, Closed=True)

# ----
geometry_2 = Geometry(polyline)
custom_preview = CustomPreview(Geometry=geometry_2, Shader=ColourSwatch(SwatchColor=RGB(255, 136, 0)))

geometry_3 = Geometry(line)
custom_preview_2 = CustomPreview(Geometry=geometry_3, Shader=ColourSwatch(SwatchColor=RGBA(177, 199, 157, 67)))

item_9 = ListItem(List=flatten(geometry_2), Index=Slider(26, range=0..100), Wrap=True)
